test file "TestModelloTeam1"

suite "New Test Suite 1"

  case "New Test Case 1" [baseline]
    model ModelloTeam1Test, harness Accensione1000W_con_errore (for ModelloTeam1Test/Subsystem)
    test sequence scenario: Accensione_1000W_errore (Accensione1000W_con_errore/Test Sequence)

  case "New Test Case 2" [baseline]
    model ModelloTeam1Test, harness Accensione1500W_e_oltre (for ModelloTeam1Test/Subsystem)
    test sequence scenario: Accensione_1500W (Accensione1500W_e_oltre/Test Sequence)

  case "New Test Case 3" [baseline]
    model ModelloTeam1Test, harness Accensione300W (for ModelloTeam1Test/Subsystem)
    test sequence scenario: Accensione_300W (Accensione300W/Test Sequence)

  case "New Test Case 4" [baseline]
    model ModelloTeam1Test, harness Accensione500W (for ModelloTeam1Test/Subsystem)
    test sequence scenario: Accensione_500W (Accensione500W/Test Sequence)

  case "New Test Case 5" [baseline]
    model ModelloTeam1Test, harness AccensioneSpegnimento (for ModelloTeam1Test/Subsystem)
    test sequence scenario: AccensioneSpegnimento (AccensioneSpegnimento/Test Sequence)

  case "New Test Case 6" [baseline]
    model ModelloTeam1Test, harness MacchinaSpenta (for ModelloTeam1Test/Subsystem)
    test sequence scenario: Macchina_spenta (MacchinaSpenta/Test Sequence)

  case "New Test Case 7" [baseline]
    model ModelloTeam1Test, harness MultiPressioneDown (for ModelloTeam1Test/Subsystem)
    test sequence scenario: MultiPressioneDown (MultiPressioneDown/Test Sequence)

  case "New Test Case 8" [baseline]
    model ModelloTeam1Test, harness PressioneConsecutivaUpDown (for ModelloTeam1Test/Subsystem)
    test sequence scenario: PressioneConsecutivaUPDOWN (PressioneConsecutivaUpDown/Test Sequence)

  case "New Test Case 9" [baseline]
    model ModelloTeam1Test, harness PressioneRidotta (for ModelloTeam1Test/Subsystem)
    test sequence scenario: PressioneRidotta (PressioneRidotta/Test Sequence)

  case "New Test Case 10" [baseline]
    model ModelloTeam1Test, harness PressioneSenzaPentola (for ModelloTeam1Test/Subsystem)
    test sequence scenario: PressioneSenzaPentola (PressioneSenzaPentola/Test Sequence)

  case "New Test Case 11" [baseline]
    model ModelloTeam1Test, harness PressioneSimultanea (for ModelloTeam1Test/Subsystem)
    test sequence scenario: PressioneSimultanea (PressioneSimultanea/Test Sequence)

  case "New Test Case 12" [baseline]
    model ModelloTeam1Test, harness Riduzione0W_e_oltre (for ModelloTeam1Test/Subsystem)
    test sequence scenario: Riduzione_0W_e_oltre (Riduzione0W_e_oltre/Test Sequence)

  case "New Test Case 13" [baseline]
    model ModelloTeam1Test, harness RimozioneInDiminuzione (for ModelloTeam1Test/Subsystem)
    test sequence scenario: RimozioneInDiminuzione (RimozioneInDiminuzione/Test Sequence)

  case "New Test Case 14" [baseline]
    model ModelloTeam1Test, harness RimozionePentolaDurantePotenza (for ModelloTeam1Test/Subsystem)
    test sequence scenario: RimozionePentolaErogazione (RimozionePentolaDurantePotenza/Test Sequence)

  case "New Test Case 15" [baseline]
    model ModelloTeam1Test, harness Rimozione_in_accensione (for ModelloTeam1Test/Subsystem)
    test sequence scenario: Rimozione_in_accensione (Rimozione_in_accensione/Test Sequence)

  case "New Test Case 16" [baseline]
    model ModelloTeam1Test, harness Spegnimento0W (for ModelloTeam1Test/Subsystem)
    test sequence scenario: Spegnimento_0W (Spegnimento0W/Test Sequence)

  case "New Test Case 17" [baseline]
    model ModelloTeam1Test, harness Blinking (for ModelloTeam1Test/Subsystem/Chart3)
    test sequence scenario: BlinkingLed (Blinking/Test Sequence)